# Grasshopper definition Rhino8_GH_unwrap_uv_texture_pro_Cluster_Pro.gh (Grasshopper 1.0.7)
# plug-ins: Kangaroo2 Components, RhinoCodePluginGH

S = Script()  # -> out, unwrapped_mesh, uv_points, uv_mesh; inputs reset: Boolean, run: Boolean, method: Int32
# ---------- S: Python ----------
import Rhino.Geometry as rg

# 方法定义（与Rhino API对应）
# LSCM = 0 (Least Squares Conformal Map)
# ABFPP = 1 (Angle Based Flattening ++)
# ARAP = 2 (As Rigid As Possible)

def run_unwrap(input_mesh, method_type):
    """Perform mesh unwrapping with selected method."""
    
    if not input_mesh:
        return None, None, None
    
    # 1. Create a working copy
    working_mesh = input_mesh.DuplicateMesh()
    
    # 2. Disable double precision to avoid MeshUnwrapper bug
    working_mesh.Vertices.UseDoublePrecisionVertices = False
    
    # 3. 根据选择的 method_type 设置展开方法
    if method_type == 0:
        unwrap_method = rg.MeshUnwrapMethod.LSCM
        method_name = "LSCM (Least Squares Conformal Map)"
    elif method_type == 1:
        unwrap_method = rg.MeshUnwrapMethod.ABFPP
        method_name = "ABF++ (Angle Based Flattening)"
    elif method_type == 2:
        unwrap_method = rg.MeshUnwrapMethod.ARAP
        method_name = "ARAP (As Rigid As Possible)"
    else:
        # 默认使用 LSCM
        unwrap_method = rg.MeshUnwrapMethod.LSCM
        method_name = "LSCM (Default)"
    
    # 4. Initialize unwrapper and compute mapping
    unwrapper = rg.MeshUnwrapper(working_mesh)
    success = unwrapper.Unwrap(unwrap_method)
    
    if not success:
        print(f"Unwrapping failed with method: {method_name}")
        return None, None, None
    
    print(f"Successfully unwrapped using: {method_name}")
    
    # 5. Extract texture coordinates
    uv_points = []
    uv_coords = []
    
    for i in range(working_mesh.TextureCoordinates.Count):
        uv = working_mesh.TextureCoordinates[i]
        uv_points.append(rg.Point3d(uv.X, uv.Y, 0))
        uv_coords.append(uv)
    
    # 6. Create UV plane mesh
    uv_mesh = create_uv_mesh(working_mesh, uv_coords)
    
    return working_mesh, uv_points, uv_mesh


def create_uv_mesh(original_mesh, uv_coords):
    """Create a flat mesh using UV coordinates as vertex positions."""
    
    if len(uv_coords) == 0:
        return None
    
    uv_mesh = rg.Mesh()
    
    # Add vertices using UV coordinates (Z=0)
    for uv in uv_coords:
        uv_mesh.Vertices.Add(uv.X, uv.Y, 0)
    
    # Copy face topology
    for i in range(original_mesh.Faces.Count):
        face = original_mesh.Faces[i]
        
        if face.IsTriangle:
            uv_mesh.Faces.AddFace(face.A, face.B, face.C)
        elif face.IsQuad:
            uv_mesh.Faces.AddFace(face.A, face.B, face.C, face.D)
    
    uv_mesh.Normals.ComputeNormals()
    uv_mesh.Compact()
    
    return uv_mesh


# ----- Grasshopper Component -----
# Inputs:
#   input_mesh (Mesh): 输入的网格
#   run (bool): Boolean Toggle - 控制是否运行
#   reset (bool): Button - 复位刷新
#   method (int): Method选择 - 0:LSCM, 1:ABFPP, 2:ARAP

# 使用模块级变量存储状态
if not hasattr(run_unwrap, 'cached_result'):
    run_unwrap.cached_result = (None, None, None)
    run_unwrap.last_run = False
    run_unwrap.last_reset = False
    run_unwrap.last_method = -1
    run_unwrap.last_mesh_id = None

# 获取当前网格的唯一标识（用于检测网格变化）
current_mesh_id = id(input_mesh) if input_mesh is not None else None

# 处理复位按钮（上升沿检测）
if reset and not run_unwrap.last_reset:
    # 复位：清空缓存和输出
    run_unwrap.cached_result = (None, None, None)
    unwrapped_mesh, uv_points, uv_mesh = (None, None, None)
    run_unwrap.last_reset = reset
    run_unwrap.last_run = False
    run_unwrap.last_method = -1
    print("Reset: All outputs cleared")
    
elif not reset:
    run_unwrap.last_reset = reset
    
    # 检查是否需要重新计算
    needs_recompute = False
    
    if run:
        # 检查各种触发重新计算的条件
        if run != run_unwrap.last_run:
            needs_recompute = True
            print("Recompute triggered: Run state changed")
        
        if current_mesh_id != run_unwrap.last_mesh_id:
            needs_recompute = True
            print("Recompute triggered: Input mesh changed")
        
        if method != run_unwrap.last_method:
            needs_recompute = True
            method_names = ["LSCM", "ABFPP", "ARAP"]
            print(f"Recompute triggered: Method changed to {method_names[method] if 0 <= method <= 2 else 'Unknown'}")
        
        if needs_recompute:
            # 执行展开计算
            result = run_unwrap(input_mesh, method)
            if result[0] is not None:
                run_unwrap.cached_result = result
                # 更新缓存的状态
                run_unwrap.last_method = method
                run_unwrap.last_mesh_id = current_mesh_id
        
        # 输出缓存的结果
        unwrapped_mesh, uv_points, uv_mesh = run_unwrap.cached_result
        run_unwrap.last_run = run
        
    else:
        # 不运行时，如果有缓存结果则显示，否则输出None
        if run_unwrap.cached_result[0] is not None:
            unwrapped_mesh, uv_points, uv_mesh = run_unwrap.cached_result
        else:
            unwrapped_mesh, uv_points, uv_mesh = (None, None, None)
        run_unwrap.last_run = run
        
else:
    # reset 为 True 且已经处理过
    if run_unwrap.cached_result[0] is not None:
        run_unwrap.cached_result = (None, None, None)
        run_unwrap.last_method = -1
    unwrapped_mesh, uv_points, uv_mesh = (None, None, None)
# ---------- end S ----------
mesh = Mesh(S.unwrapped_mesh)
pt = Point(S.uv_points)
mesh_2 = Mesh(S.uv_mesh)

# ---- group: 案例
brep = Brep(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)
brep_2 = Brep(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)
# 适用于Rhino8，平台：Windows和Mac
brep_3 = Brep(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)
brep_4 = Brep(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)

# ----
list = ValueList({"zero": 0, "One": 1, "Two": 2}, selected="zero")

# ---- group: 基准线段
crv = Curve(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)

# ---- group: 目标线段
crv_2 = Curve(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)

# ----
srf = Surface(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)
mesh_3 = Mesh(brep_2)
triremesh = TriRemesh(Geometry=mesh_3, Length=Slider(0.5, range=0..1), Iterations=25)  # -> Triangulation, Dual, Creases
bool = Boolean(Toggle(False))
mesh_4 = Mesh(mesh_3)
网格展开器 = 网格展开器(
    输入网格物件=mesh_4,
    是否生成单一网格=Toggle(False),
    reset=Button(),
    run=Toggle(True),
    bool=bool,
    method=list,
    是否对称=Toggle(True),
    对称平面=srf)  # -> txt_2, unwrapped_meshes, mesh_5, data_2

srf_2 = Surface(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)
list_2 = ValueList({"zero": 0, "One": 1, "Two": 2}, selected="zero")
mesh_5 = Mesh()
pln = Plane(srf_2)
S_2 = Script(input_mesh=mesh_5, reset=Button(), run=Toggle(True), method=list_2, use_symmetry=Toggle(True), symmetry_plane=pln)  # -> out, unwrapped_mesh, uv_points, uv_mesh; inputs input_mesh: Mesh, reset: Boolean, run: Boolean, method: Int32, use_symmetry: Boolean, symmetry_plane: Plane
# ---------- S_2: Python ----------
"""
================================================================================
Mesh Unwrapper with Symmetry Control - Grasshopper Python Component
================================================================================

功能说明:
    对输入网格执行 UV 展开，支持三种展开方法和对称平面控制。
    输出带 UV 坐标的网格、UV 点云和 UV 平面网格。

使用方法:
    1. 连接输入网格 (input_mesh)
    2. 设置 run = True 执行展开
    3. 选择展开方法 (method: 0=LSCM, 1=ABFPP, 2=ARAP)
    4. 可选: 启用对称并指定对称平面
    5. 点击 reset 清空所有输出

参数说明:
    input_mesh      - 要展开的原始网格 (Mesh)
    run             - 运行控制开关 (Boolean: True=运行, False=停止)
    reset           - 复位按钮 (Boolean: True=清空输出)
    method          - 展开方法 (Integer: 0=LSCM, 1=ABFPP, 2=ARAP)
    use_symmetry    - 启用对称 (Boolean: True=启用, False=禁用)
    symmetry_plane  - 对称平面 (Plane: 自定义平面，可选)

input:
    symmetry_plane:对称平面 (Plane: 自定义平面，可选)

输出说明:
    unwrapped_mesh  - 带有 UV 坐标的原始网格 (Mesh)
    uv_points       - UV 坐标点云 (List of Point3d)
    uv_mesh         - UV 空间的平面网格 (Mesh)

版本: 1.0
作者: Grasshopper Python Script
日期: 2026-04-28
================================================================================
"""

import Rhino.Geometry as rg

# ================================================================================
# 函数定义区
# ================================================================================

def create_uv_mesh(mesh, uv_coords):
    """
    从 UV 坐标创建平面网格
    
    参数:
        mesh: 原始网格 (用于获取面拓扑结构)
        uv_coords: UV 坐标列表 (Point2f)
    
    返回:
        uv_mesh: 在 UV 空间中创建的平面网格 (Mesh)
    
    说明:
        - 网格顶点位置由 UV 坐标 (X=U, Y=V, Z=0) 决定
        - 保持原始网格的三角形/四边形面结构
        - 自动计算法线以便正确显示
    """
    if not mesh or not uv_coords:
        return None
    
    uv_mesh = rg.Mesh()
    
    # 步骤1: 添加顶点 (使用 UV 坐标作为 3D 位置)
    for uv in uv_coords:
        uv_mesh.Vertices.Add(uv.X, uv.Y, 0)
    
    # 步骤2: 复制面的拓扑结构
    for i in range(mesh.Faces.Count):
        face = mesh.Faces[i]
        
        if face.IsTriangle:
            # 三角形面: 3个顶点索引
            uv_mesh.Faces.AddFace(face.A, face.B, face.C)
        elif face.IsQuad:
            # 四边形面: 4个顶点索引
            uv_mesh.Faces.AddFace(face.A, face.B, face.C, face.D)
    
    # 步骤3: 计算法线并清理
    uv_mesh.Normals.ComputeNormals()  # 用于正确着色显示
    uv_mesh.Compact()                 # 移除未使用的顶点
    
    return uv_mesh


def unwrap_mesh(input_mesh, method, use_symmetry, symmetry_plane):
    """
    执行网格 UV 展开
    
    参数:
        input_mesh: 输入网格 (Mesh)
        method: 展开方法 (int: 0=LSCM, 1=ABFPP, 2=ARAP)
        use_symmetry: 是否启用对称 (bool)
        symmetry_plane: 对称平面 (Plane, 可选)
    
    返回:
        working_mesh: 带 UV 坐标的网格 (Mesh)
        uv_points: UV 坐标点云 (List of Point3d)
        uv_mesh: UV 平面网格 (Mesh)
    
    算法说明:
        LSCM  (0): 最小二乘共形映射 - 平衡保角性和面积拉伸
        ABFPP (1): 基于角度的展平 - 最优保角性
        ARAP  (2): 尽可能刚性 - 最优保面积性
    
    注意事项:
        - 网格会被复制以避免修改原始数据
        - 使用单精度顶点以规避 Rhino 的已知 bug
        - 对称平面仅对本身对称的网格有效
    """
    # ===== 输入验证 =====
    if not input_mesh:
        print("错误: 没有输入网格")
        return None, None, None
    
    # ===== 步骤1: 复制网格并修正精度 =====
    # 创建网格副本，避免修改原始数据
    working_mesh = input_mesh.DuplicateMesh()
    
    # 规避 Rhino 的已知精度 bug
    # 使用单精度顶点 (Float) 代替双精度 (Double)
    working_mesh.Vertices.UseDoublePrecisionVertices = False
    
    # ===== 步骤2: 创建 Unwrapper 实例 =====
    # MeshUnwrapper 类是 Rhino 专门用于 UV 展开的核心类
    unwrapper = rg.MeshUnwrapper(working_mesh)
    
    # ===== 步骤3: 设置对称平面（如果启用）=====
    if use_symmetry:
        if symmetry_plane is not None:
            # 使用用户指定的对称平面
            unwrapper.SymmetryPlane = symmetry_plane
            print(f"✓ 对称已启用 - 使用自定义平面: {symmetry_plane}")
        else:
            # 使用默认的 XY 平面作为对称平面
            unwrapper.SymmetryPlane = rg.Plane.WorldXY
            print("✓ 对称已启用 - 使用默认平面 (World XY)")
    else:
        print("○ 对称未启用")
    
    # ===== 步骤4: 选择并执行展开方法 =====
    # 方法映射表: 用户输入值 → Rhino API 枚举值
    method_map = {
        0: rg.MeshUnwrapMethod.LSCM,   # 最小二乘共形映射
        1: rg.MeshUnwrapMethod.ABFPP,  # 基于角度的展平
        2: rg.MeshUnwrapMethod.ARAP    # 尽可能刚性
    }
    
    # 获取选中的方法，默认为 LSCM
    unwrap_method = method_map.get(method, rg.MeshUnwrapMethod.LSCM)
    
    # 方法名称（用于输出信息）
    method_names = {
        rg.MeshUnwrapMethod.LSCM: "LSCM (最小二乘共形映射)",
        rg.MeshUnwrapMethod.ABFPP: "ABF++ (基于角度的展平)",
        rg.MeshUnwrapMethod.ARAP: "ARAP (尽可能刚性)"
    }
    
    print(f"→ 执行展开方法: {method_names[unwrap_method]}")
    
    # 执行展开计算
    success = unwrapper.Unwrap(unwrap_method)
    
    if not success:
        print("✗ 展开失败！请检查网格是否有效")
        return None, None, None
    
    print("✓ 展开成功")
    
    # ===== 步骤5: 提取 UV 坐标 =====
    # 从网格中获取计算好的纹理坐标
    # TextureCoordinates 属性返回 Point2f 列表 (U, V 坐标)
    uv_coords = []
    uv_points = []
    
    texture_count = working_mesh.TextureCoordinates.Count
    print(f"→ 提取 UV 坐标: {texture_count} 个顶点")
    
    for i in range(texture_count):
        uv = working_mesh.TextureCoordinates[i]
        uv_coords.append(uv)
        # 转换为 Point3d (Z=0) 以便在 3D 空间中显示
        uv_points.append(rg.Point3d(uv.X, uv.Y, 0))
    
    # ===== 步骤6: 创建 UV 平面网格 =====
    uv_mesh = create_uv_mesh(working_mesh, uv_coords)
    
    if uv_mesh:
        print(f"✓ UV 平面网格创建成功: {uv_mesh.Vertices.Count} 顶点, {uv_mesh.Faces.Count} 面")
    
    # ===== 步骤7: 清理资源 =====
    # 释放 Unwrapper 占用的内存
    unwrapper.Dispose()
    
    # ===== 返回结果 =====
    print("=" * 50)
    print("展开完成！输出说明:")
    print("  - unwrapped_mesh: 带 UV 坐标的原始网格")
    print(f"  - uv_points: {len(uv_points)} 个 UV 坐标点")
    print("  - uv_mesh: UV 空间的平面网格")
    print("=" * 50)
    
    return working_mesh, uv_points, uv_mesh


def get_mesh_statistics(mesh):
    """
    获取网格统计信息（调试用）
    
    参数:
        mesh: 输入网格
    
    返回:
        dict: 包含顶点数、面数等统计信息
    """
    if not mesh:
        return {"error": "No mesh"}
    
    return {
        "vertices": mesh.Vertices.Count,
        "faces": mesh.Faces.Count,
        "triangles": sum(1 for f in mesh.Faces if f.IsTriangle),
        "quads": sum(1 for f in mesh.Faces if f.IsQuad),
        "has_uv": mesh.TextureCoordinates.Count > 0
    }


# ================================================================================
# Grasshopper 组件主逻辑
# ================================================================================

"""
Grasshopper 输入参数:
    input_mesh (Mesh)       - 要展开的网格
    run (bool)              - 运行控制 (Boolean Toggle)
    reset (bool)            - 复位控制 (Button)
    method (int)            - 展开方法 (Value List: 0,1,2)
    use_symmetry (bool)     - 对称开关 (Boolean Toggle)
    symmetry_plane (Plane)  - 对称平面 (Plane 组件，可选)

Grasshopper 输出参数:
    unwrapped_mesh (Mesh)   - 带 UV 坐标的网格
    uv_points (Point3d)     - UV 坐标点云
    uv_mesh (Mesh)          - UV 平面网格
"""

# ===== 状态管理 =====
# 使用函数属性存储缓存状态，避免每次运行都重新计算
if not hasattr(unwrap_mesh, 'cache'):
    unwrap_mesh.cache = {
        'result': (None, None, None),           # 缓存的结果
        'last_run': False,                       # 上次运行状态
        'last_reset': False,                     # 上次复位状态
        'last_method': -1,                       # 上次使用的方法
        'last_mesh': None,                       # 上次处理的网格ID
        'last_symmetry': False,                  # 上次对称状态
        'last_plane': None,                      # 上次平面ID
        'initialized': True                      # 初始化标志
    }

# 获取当前输入的唯一标识
current_mesh_id = id(input_mesh) if input_mesh is not None else None
current_plane_id = id(symmetry_plane) if symmetry_plane is not None else None

# ===== 复位逻辑 =====
# 检测 reset 按钮的上升沿 (False → True)
if reset and not unwrap_mesh.cache['last_reset']:
    # 执行复位: 清空所有输出和缓存
    unwrap_mesh.cache['result'] = (None, None, None)
    unwrapped_mesh = None
    uv_points = []
    uv_mesh = None
    unwrap_mesh.cache['last_reset'] = reset
    unwrap_mesh.cache['last_run'] = False
    unwrap_mesh.cache['last_method'] = -1
    unwrap_mesh.cache['last_symmetry'] = False
    unwrap_mesh.cache['last_plane'] = None
    print("\n" + "=" * 50)
    print("【复位】所有输出已清空")
    print("=" * 50)
    
elif not reset:
    # 正常执行模式 (reset = False 或 已处理)
    unwrap_mesh.cache['last_reset'] = reset
    
    # ===== 运行逻辑 =====
    if run:
        # 检查是否需要重新计算
        needs_recompute = False
        
        # 条件1: 运行状态改变
        if run != unwrap_mesh.cache['last_run']:
            needs_recompute = True
            print("\n→ 触发重新计算: 运行状态改变")
        
        # 条件2: 输入网格改变
        if current_mesh_id != unwrap_mesh.cache['last_mesh']:
            needs_recompute = True
            stats = get_mesh_statistics(input_mesh)
            if "error" not in stats:
                print(f"\n→ 触发重新计算: 输入网格改变 ({stats['vertices']} 顶点, {stats['faces']} 面)")
            else:
                print("\n→ 触发重新计算: 输入网格改变")
        
        # 条件3: 展开方法改变
        if method != unwrap_mesh.cache['last_method']:
            needs_recompute = True
            method_names_display = ["LSCM", "ABF++", "ARAP"]
            method_text = method_names_display[method] if 0 <= method <= 2 else "Unknown"
            print(f"\n→ 触发重新计算: 方法改变为 {method_text}")
        
        # 条件4: 对称开关状态改变
        if use_symmetry != unwrap_mesh.cache['last_symmetry']:
            needs_recompute = True
            print(f"\n→ 触发重新计算: 对称{'启用' if use_symmetry else '禁用'}")
        
        # 条件5: 对称平面改变
        if current_plane_id != unwrap_mesh.cache['last_plane']:
            needs_recompute = True
            print("\n→ 触发重新计算: 对称平面改变")
        
        # ===== 执行重新计算 =====
        if needs_recompute:
            print("\n" + "=" * 50)
            print("【开始执行 UV 展开】")
            print("=" * 50)
            
            result = unwrap_mesh(input_mesh, method, use_symmetry, symmetry_plane)
            
            if result[0] is not None:
                unwrap_mesh.cache['result'] = result
                unwrap_mesh.cache['last_method'] = method
                unwrap_mesh.cache['last_mesh'] = current_mesh_id
                unwrap_mesh.cache['last_symmetry'] = use_symmetry
                unwrap_mesh.cache['last_plane'] = current_plane_id
                print("\n✓ 计算完成，结果已缓存")
            else:
                print("\n✗ 计算失败，保留上次结果")
        
        # ===== 输出结果 =====
        unwrapped_mesh, uv_points, uv_mesh = unwrap_mesh.cache['result']
        unwrap_mesh.cache['last_run'] = run
        
    else:
        # run = False: 不执行计算，显示缓存结果
        if unwrap_mesh.cache['result'][0] is not None:
            unwrapped_mesh, uv_points, uv_mesh = unwrap_mesh.cache['result']
            # 可选的调试信息: print("○ 停止模式 - 显示缓存结果")
        else:
            unwrapped_mesh, uv_points, uv_mesh = (None, None, None)
        unwrap_mesh.cache['last_run'] = run
        
else:
    # reset = True 且已经处理过的状态
    if unwrap_mesh.cache['result'][0] is not None:
        unwrap_mesh.cache['result'] = (None, None, None)
        unwrap_mesh.cache['last_method'] = -1
        unwrap_mesh.cache['last_symmetry'] = False
    unwrapped_mesh, uv_points, uv_mesh = (None, None, None)


# ================================================================================
# 可选: 输出调试信息（取消注释以启用）
# ================================================================================

# 如果需要输出详细的调试信息，取消以下行的注释
"""
if input_mesh and run and not reset:
    print("\n[调试信息]")
    print(f"  - 输入网格: {get_mesh_statistics(input_mesh)}")
    print(f"  - UV点数量: {len(uv_points)}")
    print(f"  - UV网格顶点: {uv_mesh.Vertices.Count if uv_mesh else 0}")
    print(f"  - UV网格面数: {uv_mesh.Faces.Count if uv_mesh else 0}")
"""

# ================================================================================
# 使用说明（在 Grasshopper 中右键组件可查看）
# ================================================================================

"""
===============================================================================
使用说明
===============================================================================

【快速开始】
1. 连接一个网格到 input_mesh
2. 连接 Boolean Toggle 到 run，并设置为 True
3. 连接 Value List 到 method，选择展开方法
4. 查看 uv_mesh 输出查看展开结果

【对称功能】
1. 连接 Boolean Toggle 到 use_symmetry，设置为 True
2. 可选: 连接 Plane 组件到 symmetry_plane
3. 如果不连接 Plane，自动使用 World XY 平面

【控制选项】
- Run (True/False): 控制是否执行展开
- Reset (Button): 点击清空所有输出
- Method (0/1/2): LSCM=0, ABFPP=1, ARAP=2

【输出说明】
- unwrapped_mesh: 原始网格 + UV 坐标（可用于进一步处理）
- uv_points: UV 坐标点云（可用于可视化 UV 分布）
- uv_mesh: UV 空间的平面网格（可直接查看展开形状）

【常见问题】
Q: 展开失败怎么办？
A: 检查网格是否为流形网格，尝试简化网格或使用 LSCM 方法

Q: 对称不起作用？
A: 确保网格本身具有对称性，且对称平面位置正确

Q: UV 网格显示不完整？
A: 检查 uv_mesh 输出是否有数据，可能需要缩放视图

===============================================================================
"""
# ---------- end S_2 ----------
mesh_6 = Mesh(S_2.unwrapped_mesh)
pt_2 = Point(S_2.uv_points)
mesh_7 = Mesh(S_2.uv_mesh)

mesh_8 = Mesh(网格展开器.unwrapped_meshes)
mesh_9 = Mesh(网格展开器.mesh_5)

# ---- group: UV网格的定位
line = Line(crv)
line_2 = Line(crv_2)
uv网格_定位器 = UV网格_定位器(data=网格展开器.data_2, line_2=line, line=line_2)
mesh_10 = Mesh(uv网格_定位器)

# ----
panel = Panel(网格展开器.txt_2)
mesh_11 = Mesh(mesh_9)

# ---- group: 创建展开图轮廓，提取的是Mesh外轮廓线
item = ListItem(List=mesh_11, Index=0, Wrap=True)
medges = MeshEdges(Mesh=item)  # -> NakedEdges, InteriorEdges, NonManifoldEdges
join = JoinCurves(Curves=medges.NakedEdges, Preserve=False)

# ---- group: 创建曲线纹理
crv_3 = Curve([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])
crv_4 = Curve(join)
trim = TrimWithRegions(Curve=crv_3, Regions=crv_4)  # -> Inside, Outside
toggle = BooleanToggle(True)
crv_5 = Curve(trim.Inside)
clean = CleanTree(RemoveNulls=toggle, RemoveInvalid=toggle, RemoveEmpty=toggle, Tree=crv_5)

# ----
mesh_12 = Mesh(mesh_8)

# ---- group: 曲线拟合点，当然除了输入曲线外，也可以输入点point列表
crv_6 = Curve(clean)
divide = DivideCurve(Curve=crv_6, Count=Slider(100, range=0..100), Kinks=False)  # -> Points, Tangents, Parameters

# ---- group: 纹理映射方法1
meshcp = MeshClosestPoint(Point=divide.Points, Mesh=mesh_11)  # -> Point, Index, Parameter
meval = MeshEval(Mesh=mesh_12, Parameter=meshcp.Parameter)  # -> Point, Normal, Colour

# ---- group: 纹理映射方法2
meshmap = MeshMap(SourceMesh=item, TargetMesh=mesh_12, Point=divide.Points, Distance=1)
intcrv = Interpolate(Vertices=meshmap, Degree=3, Periodic=False, KnotStyle=1)  # -> Curve, Length, Domain

# ---- group: 纹理映射方法1 / 将点point拟合回对应的曲线
intcrv_2 = Interpolate(Vertices=meval.Point, Degree=3, Periodic=False, KnotStyle=1)  # -> Curve, Length, Domain

# ==== cluster 网格展开器: 一键展开网格
是否生成单一网格 = ClusterInput()
输入网格物件 = ClusterInput()  # 输入网格物件
reset = ClusterInput()
run = ClusterInput()
method = ClusterInput()
是否对称 = ClusterInput()
对称平面 = ClusterInput()
展开网格pro = 展开网格pro(mesh=输入网格物件, bool=是否生成单一网格, bool_5=reset, bool_6=run, G=method, bool_2=是否对称, pln=对称平面)  # -> txt_2, input_mesh, mesh_7, pt_2, mesh_6
pt = Point(展开网格pro.pt_2)
mesh = Mesh(展开网格pro.mesh_6)
ins = InsertItems(List=展开网格pro.txt_2, Item="############################", Indices=-1, Wrap=True)
bool = ClusterInput()

area = Area(Geometry=展开网格pro.input_mesh)  # -> Area, Centroid
group = Group(Objects=mesh)
area_2 = Area(Geometry=mesh)  # -> Area, Centroid
bbox = BoundingBox(Content=group, Plane=PlaneXY(0, 0, 0), UnionBox=False)  # -> Box, Box_2
lng = ListLength(List=mesh)
wires = BrepWireframe(Brep=bbox.Box, Density=-1)
ma = MassAddition(Input=area_2.Area)  # -> Result, PartialResults
equals = Equality(FirstNumber=lng, SecondNumber="1")  # -> Equality, Inequality
join = JoinCurves(Curves=wires, Preserve=False)
filter = StreamFilter(Gate=equals.Inequality, Stream0=area_2.Area, Stream1=ma.Result)
divide = DivideCurve(Curve=join, Count=20, Kinks=True)  # -> Points, Tangents, Parameters
avr = Average(Input=divide.Points)
division = Division(A=area.Area, B=filter)
sqrt = SquareRoot(Value=division)
scale = Scale(Geometry=group, Center=avr, Factor=sqrt)  # -> Geometry, Transform
ungroup = Ungroup(Group=scale.Geometry)
bool_2 = Boolean(bool)
mesh_2 = Mesh(mesh)
filter_2 = StreamFilter(Gate=bool_2, Stream0=mesh_2, Stream1=ungroup)
mesh_3 = Mesh(filter_2)

sqr = Square(Value=sqrt)
expression = Expression(x=sqr, y=filter, Expression="x*y")
merge = Merge(Data1=filter_2, Data2=wires)
concat = Concatenate(FragmentA="原始网格面积(Area)：", FragmentB=area.Area)
lng_2 = ListLength(List=filter_2)
filter_3 = StreamFilter(Gate=equals.Inequality, Stream0=filter_2, Stream1=merge)
ins_2 = InsertItems(List=ins, Item=concat, Indices=-1, Wrap=True)
concat_2 = Concatenate(FragmentA="展开后的平面网格面积(Area)：", FragmentB=expression)
bool_3 = Boolean(bool_2)
mesh_4 = Mesh(输入网格物件)
merge_2 = Merge(Data1=flatten(bool_3), Data2=flatten(mesh_4), Data3=flatten(filter_3), Data4=flatten(lng_2))
ins_3 = InsertItems(List=ins_2, Item=concat_2, Indices=-1, Wrap=True)
unwrapped_meshes = ClusterOutput(展开网格pro.mesh_7)  # 原网格
data = Data(merge_2)
txt = Text(ins_3)
mesh_5 = ClusterOutput(mesh_3)  # 展开后的平面网格
data_2 = ClusterOutput(data)  # data
txt_2 = ClusterOutput(txt)

# ==== cluster UV网格_定位器: UV网格_定位器
data = ClusterInput()  # data
line = ClusterInput()
line_2 = ClusterInput()
data_2 = Data(data)

# ---- group: 筛选data
panel = Panel("-1")
item = ListItem(List=data_2, Index=panel, Wrap=True)
split = SplitList(List=data_2, Index="2")  # -> ListA, ListB
cull_i = CullIndex(List=split.ListB, Indices=panel, Wrap=True)
item_2 = ListItem(List=split.ListA, Index=0, Wrap=True)  # -> Item, Item1
split_2 = SplitList(List=cull_i, Index=item)  # -> ListA, ListB

# ----
line_3 = Line(line)
line_4 = Line(line_2)

# ---- group: 获取中点
item_3 = ListItem(List=split_2.ListB, Index=panel, Wrap=True)
midpt = CurveMiddle(Curve=item_3)

# ----
mesh = Mesh(split_2.ListA)
group = Group(Objects=mesh)
ungroup = Ungroup(Group=group)
mesh_2 = Mesh(item_2.Item1)
cluster = Cluster_2(M_2=ungroup, M=mesh_2, C=line_4)
end = EndPoints(Curve=line_3)  # -> Start, End
null = NullItem(Item=cluster)  # -> NullFlags, InvalidFlags, Description
dispatch = Dispatch(List=cluster, DispatchPattern=null.NullFlags)  # -> ListA, ListB
merge = Merge(Data1=end.Start, Data2=end.End)
avr = Average(Input=merge)
item_4 = ListItem(List=dispatch.ListB, Index=0, Wrap=True)  # -> Item, Item1
avr_2 = Average(Input=dispatch.ListB)
vec2pt = Vector2Pt(PointA=item_4.Item, PointB=item_4.Item1, Unitize=False)  # -> Vector, Length
vec2pt_2 = Vector2Pt(PointA=end.Start, PointB=end.End, Unitize=False)  # -> Vector, Length
vec2pt_3 = Vector2Pt(PointA=avr_2, PointB=item_4.Item1, Unitize=False)  # -> Vector, Length
orient = OrientDirection(Geometry=group, PointA=item_4.Item, DirectionA=vec2pt.Vector, PointB=end.Start, DirectionB=vec2pt_2.Vector)  # -> Geometry, Transform
orient_2 = OrientDirection(Geometry=group, PointA=avr_2, DirectionA=vec2pt_3.Vector, PointB=avr, DirectionB=vec2pt_3.Vector)  # -> Geometry, Transform
bool = Boolean(item_2.Item)
filter = StreamFilter(Gate=bool, Stream0=orient.Geometry, Stream1=orient_2.Geometry)
ungroup_2 = Ungroup(Group=filter)
mesh_3 = Mesh(ungroup_2)
mesh_4 = ClusterOutput(mesh_3)

# ==== cluster 展开网格pro: 一键展开网格pro
mesh = ClusterInput()
bool = ClusterInput()
mesh_2 = Mesh(mesh)
panel = Panel("""0
1
2""")
bool_2 = ClusterInput()
pln = ClusterInput()
bool_3 = Boolean(bool)
bool_4 = Boolean(bool_2)
pln_2 = Plane(pln)
cluster = Cluster(mesh=mesh_2, bool=bool_3)
G = ClusterInput()
item = ListItem(List=panel, Index=0, Wrap=True)  # -> Item, Item1, Item2
bool_5 = ClusterInput()
bool_6 = ClusterInput()
filter = StreamFilter(Gate=G, Stream0=item.Item, Stream1=item.Item1, Stream2=item.Item2)
bool_7 = Boolean(bool_5)
bool_8 = Boolean(bool_6)
S = Script(input_meshes=cluster, reset=bool_7, run=bool_8, method=filter, use_symmetry=bool_4, symmetry_plane=pln_2)  # -> out, unwrapped_meshes, uv_points, uv_meshes; inputs input_meshes: list of Mesh, reset: Boolean, run: Boolean, method: Int32, use_symmetry: Boolean, symmetry_plane: Plane
# ---------- S: Python ----------
"""
================================================================================
Mesh Unwrapper with Symmetry Control - Multi-Mesh Support
================================================================================

功能说明:
    对单个或多个网格执行 UV 展开，支持三种展开方法和对称平面控制。
    
版本: 2.1 (修复输出格式问题)
================================================================================
"""

import Rhino.Geometry as rg

# ================================================================================
# 辅助函数定义
# ================================================================================

def ensure_list(data):
    """
    确保输入数据为列表格式
    
    参数:
        data: 单个对象或对象列表
    
    返回:
        list: 统一的对象列表
    """
    if data is None:
        return []
    if isinstance(data, list):
        return data
    if hasattr(data, '__iter__') and not isinstance(data, (str, rg.Mesh)):
        return list(data)
    return [data]


def create_uv_mesh_from_mesh(mesh, uv_coords):
    """
    从单个网格的 UV 坐标创建平面网格
    """
    if not mesh or not uv_coords or len(uv_coords) == 0:
        return None
    
    uv_mesh = rg.Mesh()
    
    # 添加顶点 (使用 UV 坐标作为 3D 位置)
    for uv in uv_coords:
        uv_mesh.Vertices.Add(uv.X, uv.Y, 0)
    
    # 复制面的拓扑结构
    for i in range(mesh.Faces.Count):
        face = mesh.Faces[i]
        
        if face.IsTriangle:
            uv_mesh.Faces.AddFace(face.A, face.B, face.C)
        elif face.IsQuad:
            uv_mesh.Faces.AddFace(face.A, face.B, face.C, face.D)
    
    # 计算法线并清理
    uv_mesh.Normals.ComputeNormals()
    uv_mesh.Compact()
    
    return uv_mesh


def unwrap_meshes(input_meshes, method, use_symmetry, symmetry_plane):
    """
    执行多个网格的 UV 展开（使用多网格构造函数）
    
    返回:
        unwrapped_meshes: 带 UV 坐标的网格列表 (List of Mesh)
        all_uv_points: 所有 UV 坐标点云（扁平列表）(List of Point3d)
        uv_meshes: UV 平面网格列表 (List of Mesh)
    """
    # ===== 输入验证 =====
    if not input_meshes or len(input_meshes) == 0:
        print("错误: 没有输入网格")
        return None, None, None
    
    mesh_count = len(input_meshes)
    print(f"\n→ 准备展开 {mesh_count} 个网格")
    
    # ===== 步骤1: 复制所有网格并修正精度 =====
    working_meshes = []
    for i, mesh in enumerate(input_meshes):
        if mesh:
            working_mesh = mesh.DuplicateMesh()
            working_mesh.Vertices.UseDoublePrecisionVertices = False
            working_meshes.append(working_mesh)
        else:
            print(f"警告: 网格 {i} 为 None，已跳过")
            working_meshes.append(None)
    
    # 过滤掉 None 网格
    valid_meshes = [m for m in working_meshes if m is not None]
    if len(valid_meshes) == 0:
        print("错误: 没有有效的网格")
        return None, None, None
    
    # ===== 步骤2: 创建多网格 Unwrapper 实例 =====
    print("→ 创建多网格 MeshUnwrapper 实例")
    unwrapper = rg.MeshUnwrapper(valid_meshes)
    
    # ===== 步骤3: 设置对称平面 =====
    if use_symmetry:
        if symmetry_plane is not None:
            unwrapper.SymmetryPlane = symmetry_plane
            print(f"✓ 对称已启用 - 使用自定义平面")
        else:
            unwrapper.SymmetryPlane = rg.Plane.WorldXY
            print("✓ 对称已启用 - 使用默认平面 (World XY)")
    else:
        print("○ 对称未启用")
    
    # ===== 步骤4: 选择并执行展开方法 =====
    method_map = {
        0: rg.MeshUnwrapMethod.LSCM,
        1: rg.MeshUnwrapMethod.ABFPP,
        2: rg.MeshUnwrapMethod.ARAP
    }
    
    method_names = {
        rg.MeshUnwrapMethod.LSCM: "LSCM (最小二乘共形映射)",
        rg.MeshUnwrapMethod.ABFPP: "ABF++ (基于角度的展平)",
        rg.MeshUnwrapMethod.ARAP: "ARAP (尽可能刚性)"
    }
    
    unwrap_method = method_map.get(method, rg.MeshUnwrapMethod.LSCM)
    print(f"→ 执行展开方法: {method_names[unwrap_method]}")
    
    # 执行展开计算
    success = unwrapper.Unwrap(unwrap_method)
    
    if not success:
        print("✗ 展开失败！")
        unwrapper.Dispose()
        return None, None, None
    
    print("✓ 展开成功")
    
    # ===== 步骤5: 从每个网格提取 UV 坐标 =====
    unwrapped_meshes = []
    all_uv_points = []  # 扁平列表，存储所有 UV 点
    uv_meshes = []
    
    total_uv_points = 0
    
    for i, mesh in enumerate(working_meshes):
        if mesh is None:
            unwrapped_meshes.append(None)
            uv_meshes.append(None)
            continue
        
        # 提取 UV 坐标
        uv_coords = []
        uv_points = []
        
        texture_count = mesh.TextureCoordinates.Count
        print(f"→ 网格 {i}: {texture_count} 个 UV 坐标")
        
        for j in range(texture_count):
            uv = mesh.TextureCoordinates[j]
            uv_coords.append(uv)
            point = rg.Point3d(uv.X, uv.Y, 0)
            uv_points.append(point)
            all_uv_points.append(point)  # 添加到扁平列表
        
        total_uv_points += len(uv_points)
        
        # 创建 UV 平面网格
        uv_mesh = create_uv_mesh_from_mesh(mesh, uv_coords)
        
        unwrapped_meshes.append(mesh)
        uv_meshes.append(uv_mesh)
    
    # ===== 步骤6: 清理资源 =====
    unwrapper.Dispose()
    
    # ===== 输出统计信息 =====
    print("\n" + "=" * 50)
    print(f"展开完成！")
    print(f"  - 网格数量: {len(valid_meshes)}")
    print(f"  - UV 点总数: {total_uv_points}")
    print("=" * 50)
    
    return unwrapped_meshes, all_uv_points, uv_meshes


def get_meshes_statistics(meshes):
    """获取多个网格的统计信息"""
    if not meshes:
        return {"count": 0, "total_vertices": 0, "total_faces": 0}
    
    total_vertices = 0
    total_faces = 0
    valid_count = 0
    
    for mesh in meshes:
        if mesh:
            valid_count += 1
            total_vertices += mesh.Vertices.Count
            total_faces += mesh.Faces.Count
    
    return {
        "count": valid_count,
        "total_vertices": total_vertices,
        "total_faces": total_faces
    }


def flatten_output(data):
    """
    将嵌套列表展平为 Grasshopper 兼容的格式
    """
    if data is None:
        return []
    if isinstance(data, list):
        # 如果是列表的列表，展平它
        result = []
        for item in data:
            if isinstance(item, list):
                result.extend(item)
            else:
                result.append(item)
        return result
    return [data]


# ================================================================================
# Grasshopper 组件主逻辑
# ================================================================================

"""
Grasshopper 输入参数:
    input_meshes      - 要展开的网格 (Mesh 或 List of Mesh)
    run               - 运行控制 (Boolean Toggle)
    reset             - 复位控制 (Button)
    method            - 展开方法 (0=LSCM, 1=ABFPP, 2=ARAP)
    use_symmetry      - 对称开关 (Boolean Toggle)
    symmetry_plane    - 对称平面 (Plane 组件，可选)

Grasshopper 输出参数:
    unwrapped_meshes  - 带 UV 坐标的网格列表 (List of Mesh)
    uv_points         - 所有 UV 坐标点云 (扁平列表, List of Point3d)
    uv_meshes         - UV 平面网格列表 (List of Mesh)
"""

# 确保输入为列表格式
meshes_list = ensure_list(input_meshes)

# ===== 状态管理 =====
if not hasattr(unwrap_meshes, 'cache'):
    unwrap_meshes.cache = {
        'result': (None, None, None),        # (unwrapped_meshes, uv_points, uv_meshes)
        'last_run': False,
        'last_reset': False,
        'last_method': -1,
        'last_meshes_hash': None,
        'last_mesh_count': 0,
        'last_symmetry': False,
        'last_plane': None
    }

# 获取当前输入的哈希值
def get_meshes_hash(meshes):
    if not meshes:
        return None
    mesh_ids = [id(m) for m in meshes if m is not None]
    return (len(meshes), tuple(mesh_ids))

current_mesh_hash = get_meshes_hash(meshes_list)
current_plane_id = id(symmetry_plane) if symmetry_plane is not None else None

# ===== 复位逻辑 =====
if reset and not unwrap_meshes.cache['last_reset']:
    # 清空所有输出
    unwrap_meshes.cache['result'] = (None, None, None)
    unwrapped_meshes = None
    uv_points = []
    uv_meshes = None
    
    unwrap_meshes.cache['last_reset'] = reset
    unwrap_meshes.cache['last_run'] = False
    unwrap_meshes.cache['last_method'] = -1
    unwrap_meshes.cache['last_symmetry'] = False
    unwrap_meshes.cache['last_plane'] = None
    
    print("\n【复位】所有输出已清空")
    
elif not reset:
    unwrap_meshes.cache['last_reset'] = reset
    
    if run:
        # 检查是否需要重新计算
        needs_recompute = False
        
        if run != unwrap_meshes.cache['last_run']:
            needs_recompute = True
            print("\n→ 触发重新计算: 运行状态改变")
        
        if current_mesh_hash != unwrap_meshes.cache['last_meshes_hash']:
            needs_recompute = True
            stats = get_meshes_statistics(meshes_list)
            print(f"\n→ 触发重新计算: 输入网格改变 ({stats['count']} 个网格)")
        
        if len(meshes_list) != unwrap_meshes.cache['last_mesh_count']:
            needs_recompute = True
            print(f"\n→ 触发重新计算: 网格数量改变")
        
        if method != unwrap_meshes.cache['last_method']:
            needs_recompute = True
            method_names_display = ["LSCM", "ABF++", "ARAP"]
            method_text = method_names_display[method] if 0 <= method <= 2 else "Unknown"
            print(f"\n→ 触发重新计算: 方法改变为 {method_text}")
        
        if use_symmetry != unwrap_meshes.cache['last_symmetry']:
            needs_recompute = True
            print(f"\n→ 触发重新计算: 对称{'启用' if use_symmetry else '禁用'}")
        
        if current_plane_id != unwrap_meshes.cache['last_plane']:
            needs_recompute = True
            print("\n→ 触发重新计算: 对称平面改变")
        
        if needs_recompute:
            print("\n【开始执行多网格 UV 展开】")
            
            result = unwrap_meshes(meshes_list, method, use_symmetry, symmetry_plane)
            
            if result[0] is not None:
                unwrap_meshes.cache['result'] = result
                unwrap_meshes.cache['last_method'] = method
                unwrap_meshes.cache['last_meshes_hash'] = current_mesh_hash
                unwrap_meshes.cache['last_mesh_count'] = len(meshes_list)
                unwrap_meshes.cache['last_symmetry'] = use_symmetry
                unwrap_meshes.cache['last_plane'] = current_plane_id
                print("✓ 计算完成")
            else:
                print("✗ 计算失败")
        
        # 输出结果
        unwrapped_meshes, uv_points, uv_meshes = unwrap_meshes.cache['result']
        unwrap_meshes.cache['last_run'] = run
        
    else:
        # run = False: 显示缓存结果
        if unwrap_meshes.cache['result'][0] is not None:
            unwrapped_meshes, uv_points, uv_meshes = unwrap_meshes.cache['result']
        else:
            unwrapped_meshes = None
            uv_points = []
            uv_meshes = None
        unwrap_meshes.cache['last_run'] = run
        
else:
    # reset = True 且已处理
    if unwrap_meshes.cache['result'][0] is not None:
        unwrap_meshes.cache['result'] = (None, None, None)
    unwrapped_meshes = None
    uv_points = []
    uv_meshes = None


# ================================================================================
# 可选：将输出转换为 Grasshopper 友好格式
# ================================================================================

# 确保 uv_points 是 Grasshopper 可以处理的格式
if uv_points is None:
    uv_points = []
elif not isinstance(uv_points, list):
    uv_points = [uv_points]

# 如果 unwrapped_meshes 和 uv_meshes 是单个对象，转换为列表
if unwrapped_meshes is not None and not isinstance(unwrapped_meshes, list):
    unwrapped_meshes = [unwrapped_meshes]

if uv_meshes is not None and not isinstance(uv_meshes, list):
    uv_meshes = [uv_meshes]
# ---------- end S ----------
mesh_3 = Mesh(S.uv_meshes)
mesh_4 = Mesh(S.unwrapped_meshes)
pt = Point(S.uv_points)
txt = Text(S.out)
mesh_5 = Mesh(mesh_2)
input_mesh = ClusterOutput(mesh_5)  # Input_mesh
mesh_6 = ClusterOutput(mesh_3)
mesh_7 = ClusterOutput(mesh_4)
pt_2 = ClusterOutput(pt)
txt_2 = ClusterOutput(txt)

# ==== cluster Cluster_2
C = ClusterInput()
end = EndPoints(Curve=C)  # -> Start, End
merge = Merge(Data1=end.Start, Data2=end.End)
M = ClusterInput()
M_2 = ClusterInput()
meshcp = MeshClosestPoint(Point=merge, Mesh=M)  # -> Point, Index, Parameter
meval = MeshEval(Mesh=M_2, Parameter=meshcp.Parameter)  # -> Point, Normal, Colour
P = ClusterOutput(meval.Point)

# ==== cluster Cluster
mesh = ClusterInput()
bool = ClusterInput()
mesh_2 = Mesh(mesh)
bool_2 = Boolean(bool)

# ---- group: Mesh必须三角化
tri = Triangulate(Mesh=mesh_2)  # -> Mesh, Count

# ---- group: 炸开Mesh
S = Script(M=tri.Mesh)  # -> out, ExplodedMeshes; inputs M: Mesh
# ---------- S: Python ----------
"""
输入: M (Mesh) - 需要被炸开的原始Mesh
输出: ExplodedMeshes (list) - 炸开后生成的子Mesh列表
"""

import rhinoscriptsyntax as rs
import Grasshopper as gh

# 检查输入是否有效
if M is None:
    print("请提供一个Mesh几何体。")
    ExplodedMeshes = []
else:
    # 核心方法：在未焊接边处炸开Mesh，返回子Mesh数组
    sub_meshes = M.ExplodeAtUnweldedEdges()
    
    if sub_meshes:
        ExplodedMeshes = list(sub_meshes)
        # 可选：在Rhino视口中高亮显示生成结果，方便调试
        for sub_mesh in ExplodedMeshes:
            if not sub_mesh.IsValid:
                print("警告：生成的一个子Mesh无效。")
        print(f"成功! 原始Mesh被炸开为 {len(ExplodedMeshes)} 个子Mesh部件。")
    else:
        # 如果返回的列表只有一个元素或为空，通常意味着Mesh没有可炸开的未焊接边
        print("操作未改变Mesh。这个Mesh可能本身就是由焊接边连接的单一连续体，无法进一步炸开。")
        ExplodedMeshes = [M] # 返回原始Mesh作为结果
# ---------- end S ----------

# ---- group: Mesh最好焊接为一个整体，否则可能展开的是独立的mesh
weld = WeldMesh(Mesh=tri.Mesh, Angle=3.141592654)

# ----
int = Integer(bool_2)
filter = StreamFilter(Gate=int, Stream0=S.ExplodedMeshes, Stream1=weld)
mesh_3 = Mesh(filter)
mesh_4 = ClusterOutput(mesh_3)
