# Grasshopper definition 齿轮-v1-2026.gh (Grasshopper 1.0.8)

# ---- group: 标准齿轮
# 1.标准直齿轮
number_slider = Slider(2, range=0..10)
cluster = Cluster(m=number_slider, int=Slider(23, range=0..100), bool=Toggle(True), num=Slider(1.38, range=-1..2))  # -> R, geo_2
preview = CustomPreview(Geometry=cluster.geo_2, Material=ColourSwatch(SwatchColor=RGB(97, 145, 145)))

# ---- group: 锥形齿轮
# 2.锥形齿轮
number_slider_2 = Slider(26, range=0..100)
number_slider_3 = Slider(23, range=0..100)
锥形齿轮 = 锥形齿轮(
    m=Slider(2, range=0..10),
    z=number_slider_3,
    z_mating=number_slider_3,
    b=Slider(46, range=0..100),
    alpha=number_slider_2,
    H=Slider(26, range=0..100))  # -> crv_2, B
preview_2 = CustomPreview(
    Geometry=锥形齿轮.B,
    Material={diffuse=RGB(228, 178, 227), emission=RGB(68, 53, 68), shine=0.5, specular=RGB(255, 254, 254), transparency=0})

# ==== cluster Cluster
int = ClusterInput()
bool = ClusterInput()
int_2 = Integer(int)

expression = Expression(z=int_2, Expression="0.45 + (z * 0.012) - (z * z * 0.00004)")
expression_2 = Expression(z=int_2, Expression="(17 - z) / 17")
num = ClusterInput()
panel = Panel("变位系数 \(x\) (x-factor)")
num_2 = Number(num)
max = Maximum(A=num_2, B=expression)
min = Minimum(A=max, B=expression_2)
bool_2 = Boolean(bool)
filter = StreamFilter(Gate=bool_2, Stream0=min, Stream1="False")

int_3 = Integer(int_2)
m = ClusterInput()
num_3 = Number(filter)
S = Script(m=m, z=int_3, x=num_3)  # -> out, m, z, A, d, da, df, db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
# ---------- S: Python ----------
import math


m = m #模数 (m)，反映齿轮轮齿大小的几何参数，国家有标准系列值（如 1, 1.5, 2, 2.5, 3, 4 等）。
z = z #齿数 (z)，齿轮轮齿的总数。
A = math.radians(20)  #压力角A,标准齿轮的压力角规定为 20度，（部分特殊设计或英制采用 14.5度 或 25度)。

#标准正常齿规定 (h_a = 1)，(c_c = 0.25)；
#短齿规定(h_a = 0.8)，\(c_c = 0.3)。
h_a = 1 #齿顶高系数h_a;
c_c = 0.25

d = m*z #分度圆直径d;计算和测量的基准圆
ha = (h_a+x)*m #齿顶高ha;标准正常齿：ha = m



hf = (h_a+c_c-x)*m #齿根高hf;标准正常齿：hf =1.25* m
h = ha+hf #全齿高h;标准正常齿：h =2.25* m

da = d+2*ha #齿顶圆直径da;标准正常齿：da = m*(z+2)
df = d-2*hf #齿根圆直径df;标准正常齿：df = m*(z-2.5)
db = d*math.cos(A) #基圆直径db;渐开线起始圆,A=20时,db = 0.9397*d
p = math.pi*m #齿距p;分度圆上相邻两齿同侧轮廓间的弧长

rb = 1/2*db #基圆半径rb

s = 1/2*math.pi*m #齿厚s;标准齿轮在分度圆上齿厚等于槽宽
e = s #槽宽e;标准齿轮在分度圆上齿厚等于槽宽
# ---------- end S ----------
panel_2 = Panel(S.rb)

# ---- group: 渐开线
dom = ConstructDomain(DomainStart=0, DomainEnd="0.8")
range = Range(Domain=dom, Steps="100")
expression_3 = Expression(rb=S.rb, t=range, Expression="rb*(Sin(t)-t*Cos(t))")
expression_4 = Expression(rb=S.rb, t=range, Expression="rb*(Cos(t)+t*Sin(t))")
pt = ConstructPoint(XCoordinate=expression_3, YCoordinate=expression_4, ZCoordinate=0)
intcrv = Interpolate(Vertices=pt, Degree=3, Periodic=False, KnotStyle=1)  # -> Curve, Length, Domain

# ----
merge = Merge(Data1=S.d, Data2=S.da, Data3=S.df, Data4=S.db)
pt_2 = ConstructPoint(XCoordinate=0, YCoordinate=0, ZCoordinate=0)
pln = Plane(pt_2)
expression_5 = Expression(z=S.z, A=S.A, Expression="π/(2*z)+Tan(A)-A")
cir = Circle(Plane=pln, Radius=expr("0.5*x", merge))
sort = SortList(Keys=cir, ValuesA=cir)  # -> Keys, ValuesA
item = ListItem(List=sort.ValuesA, Index=0, Wrap=True)  # -> Item, Item1, Item2, Item3
rotate = Rotate(Geometry=intcrv.Curve, Angle=expression_5, Plane=pln)  # -> Geometry, Transform
end = EndPoints(Curve=rotate.Geometry)  # -> Start, End
pt_3 = Point(end.Start)
ln = Line(StartPoint=pt_3, EndPoint=pln)
merge_2 = Merge(Data1=rotate.Geometry, Data2=ln)
join = JoinCurves(Curves=merge_2, Preserve=False)
mirror = Mirror(Geometry=join, Plane=PlaneYZ(0, 0, 0))  # -> Geometry, Transform
merge_3 = Merge(Data1=join, Data2=mirror.Geometry)
ccx = CurveCurve(CurveA=merge_3, CurveB=item.Item3)  # -> Points, ParamsA, ParamsB
shatter = Shatter(Curve=merge_3, Parameters=flatten(ccx.ParamsA))
shatter_2 = Shatter(Curve=item.Item3, Parameters=flatten(ccx.ParamsB))
item_2 = ListItem(List=shatter_2, Index=0, Wrap=True)
item_3 = ListItem(List=shatter, Index=0, Wrap=True)
merge_4 = Merge(Data1=item_3, Data2=item_2)  # -> flatten(Result)
join_2 = JoinCurves(Curves=merge_4, Preserve=False)
arrpolar = PolarArray(Geometry=join_2, Plane=pln, Count=S.z, Angle=6.283185307)  # -> Geometry, Transform
merge_5 = Merge(Data1=arrpolar.Geometry, Data2=item.Item)  # -> flatten(Result)
runion = RegionUnion(Curves=merge_5, Plane=pln)
Z = UnitZ(Factor=S.s)
extr = Extrude(Base=runion, Direction=Z)
cap = CapHoles(Brep=extr)
geo = Geometry(cap)
R = ClusterOutput(runion)
geo_2 = ClusterOutput(geo)

# ==== cluster 锥形齿轮
m = ClusterInput()
z = ClusterInput()
z_mating = ClusterInput()
b = ClusterInput()
alpha = ClusterInput()
H = ClusterInput()
S = Script(m=m, z=z, z_mating=z_mating, b=b, Alpha=alpha, H=H)  # -> out, m, z, z_mating, b, Alpha, H, r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
# ---------- S: Python ----------
import math

# ==========================================
# 1. 基础参数安全获取与默认值（防止全局自赋值报错）
# ==========================================
# 假设输入端有 m, z, z_mating, b, Alpha
m = float(m) if 'm' in locals() else 2.0
z = int(z) if 'z' in locals() else 20
z_mating = int(z_mating) if 'z_mating' in locals() else 20
b = float(b) if 'b' in locals() else 15.0
Alpha = float(Alpha) if 'Alpha' in locals() else 20.0

# ==========================================
# 2. 数学函数别名
# ==========================================
Radians = math.radians
Pi = math.pi
Cos = math.cos
Sin = math.sin
Tan = math.tan
Atan = math.atan

# ==========================================
# 3. 锥齿轮核心参数计算
# ==========================================
r = m * z / 2.0                 # 实际分度圆半径
Delta = Atan(z / float(z_mating))  # 分度圆锥角 (弧度)
Re = r / Sin(Delta)             # 外锥距 (锥长)

# 齿宽限制安全检查
if b > Re / 3.0:
    b = Re / 3.0

# 齿高计算（严格采用国标标准正常齿：ha*=1, c*=0.25）
ha = 1.0 * m                    # 齿顶高
hf = 1.25 * m                   # 齿根高 (国标标准正常齿为 1.25m)

theta_a = Atan(ha / Re)         # 齿顶角
theta_f = Atan(hf / Re)         # 齿根角 

Delta_a = Delta + theta_a       # 面锥角
Delta_f = Delta - theta_f       # 根锥角

# ==========================================
# 4. 大端背锥当量圆参数计算 (用于推导 2D 渐开线)
# ==========================================
rv = r / Cos(Delta)             # 当量分度圆半径 (物理大端在背锥展开后的半径)
rvb = rv * Cos(Radians(Alpha))  # 当量基圆半径

# 严格依据国标公式计算：分度圆单侧半齿厚对应的圆心张角 theta
# 包含了渐开线函数 inv(α) = tanα - α 的严格修正
inv_alpha = Tan(Radians(Alpha)) - Radians(Alpha)
theta = Pi / (2.0 * z * Cos(Delta)) + inv_alpha

# 修正后的当量大端齿顶圆、齿根圆半径（画 2D 轮廓的截面线时用这两个）
rva = rv + ha                   # 当量大端齿顶圆半径
rvf = rv - hf                   # 当量大端齿根圆半径

# ==========================================
# 5. 输出变量给 Grasshopper (可选)
# ==========================================
# 此时你可以在下方直接用这些变量和 Rhino.Geometry 计算点、生成曲线了
# ---------- end S ----------
pt = ConstructPoint(XCoordinate=0, YCoordinate=0, ZCoordinate=0)
渐开线 = 渐开线(num=S.rvb)

panel = Panel("输出分度圆锥角Delta/δ")
expression = Expression(z=S.z, z_mating=S.z_mating, Expression="Atan(z/z_mating)")

rotate = Rotate(Geometry=渐开线, Angle=expr("-x", S.theta), Plane=PlaneXY(0, 0, 0))  # -> Geometry, Transform
merge = Merge(Data1=S.rva, Data2=S.rvf)
cir = Circle(Plane=PlaneXY(0, 0, 0), Radius=merge)
end = EndPoints(Curve=rotate.Geometry)  # -> Start, End
pt_2 = Point(end.Start)
item = ListItem(List=cir, Index=0, Wrap=True)  # -> Item, Item1
ln = Line(StartPoint=pt_2, EndPoint=pt)
merge_2 = Merge(Data1=rotate.Geometry, Data2=ln)

expression_2 = Expression(m=S.m, z=S.z, Delta=expression, Expression="(m*z/2)/Cos(Delta)")
panel_2 = Panel("分度圆半径rv")

join = JoinCurves(Curves=merge_2, Preserve=False)
ccx = CurveCurve(CurveA=join, CurveB=cir)  # -> Points, ParamsA, ParamsB
shatter = Shatter(Curve=join, Parameters=flatten(ccx.ParamsA))
item_2 = ListItem(List=shatter, Index=1, Wrap=True)

rad = Radians(Degrees=S.Alpha)
expression_3 = Expression(rv=expression_2, Alpha=rad, Expression="rv*Cos(Alpha)")
panel_3 = Panel("基圆半径rvb")

xz = XZPlane(Origin=Point(0, 0, 0))
mirror = Mirror(Geometry=item_2, Plane=xz)  # -> Geometry, Transform
merge_3 = Merge(Data1=mirror.Geometry, Data2=item_2)
ccx_2 = CurveCurve(CurveA=merge_3, CurveB=graft(cir))  # -> Points, ParamsA, ParamsB

rad_2 = Radians(Degrees=S.Alpha)
expression_4 = Expression(z=S.z, Delta=expression, Alpha=rad_2, Expression="π/(2*z*Cos(Delta))+ Tan(Alpha)-Alpha")
panel_4 = Panel("分度圆单侧半齿厚对应的圆心张角theta")

trim = TrimTree(Tree=ccx_2.ParamsB, Depth=1)
shatter_2 = Shatter(Curve=graft(cir), Parameters=trim)
trim_2 = TrimTree(Tree=shatter_2, Depth=1)
item_3 = ListItem(List=trim_2, Index=-1, Wrap=True)
merge_4 = Merge(Data1=item_3, Data2=merge_3)  # -> flatten(Result)
join_2 = JoinCurves(Curves=merge_4, Preserve=False)
arrpolar = PolarArray(Geometry=join_2, Plane=PlaneXY(0, 0, 0), Count=S.z, Angle=6.283185307)  # -> Geometry, Transform
pln = Plane(pt)
Z = UnitZ(Factor=S.H)
merge_5 = Merge(Data1=arrpolar.Geometry, Data2=item.Item1)  # -> flatten(Result)
runion = RegionUnion(Curves=merge_5)
move = Move(Geometry=pln, Motion=Z)  # -> Geometry, Transform
orient = Orient(Geometry=runion, Source=pln, Target=move.Geometry)  # -> Geometry, Transform
expression_5 = Expression(b=S.b, Re=S.Re, Expression="(Re-b)/Re")
scale = Scale(Geometry=orient.Geometry, Center=move.Geometry, Factor=expression_5)  # -> Geometry, Transform
merge_6 = Merge(Data1=runion, Data2=scale.Geometry)
loft = Loft(Curves=merge_6, Options={Adjust=False, Closed=False, LoftEnds=0, LoftSimp=0, LoftType=0, Rebuild=10, Refit=0.01})
cap = CapHoles(Brep=loft)
crv = Curve(merge_6)
B = ClusterOutput(cap)
crv_2 = ClusterOutput(crv)

# ==== cluster 渐开线
num = ClusterInput()

num_2 = Number(num)
dom = ConstructDomain(DomainStart=0, DomainEnd="0.8")
range = Range(Domain=dom, Steps="20")
expression = Expression(rvb=num_2, t=range, Expression="rvb*(Cos(t)+t*Sin(t))")
expression_2 = Expression(rvb=num_2, t=range, Expression="rvb*(Sin(t)-t*Cos(t))")
pt = ConstructPoint(XCoordinate=expression, YCoordinate=expression_2, ZCoordinate=0)
intcrv = Interpolate(Vertices=pt, Degree=3, Periodic=False, KnotStyle=1)  # -> Curve, Length, Domain

C = ClusterOutput(intcrv.Curve)
