# Grasshopper definition 齿轮-v1-锥形齿轮-2026.gh (Grasshopper 1.0.7)

number_slider = Slider(20, range=0..100)
锥形齿轮 = 锥形齿轮(
    m=Slider(2, range=0..10),
    z=number_slider,
    z_mating=number_slider,
    b=Slider(31, range=0..100),
    alpha=Slider(27, range=0..100),
    H=Slider(32, range=0..100))  # -> crv_2, B
preview = CustomPreview(
    Geometry=锥形齿轮.B,
    Material={diffuse=RGB(228, 178, 227), emission=RGB(68, 53, 68), shine=0.5, specular=RGB(255, 254, 254), transparency=0})

# ==== cluster 锥形齿轮
m = ClusterInput()
z = ClusterInput()
z_mating = ClusterInput()
b = ClusterInput()
alpha = ClusterInput()
H = ClusterInput()
S = Script(m=m, z=z, z_mating=z_mating, b=b, Alpha=alpha, H=H)  # -> out, m, z, z_mating, b, Alpha, H, r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
# ---------- S: Python ----------
import math

# ==========================================
# 1. 基础参数安全获取与默认值（防止全局自赋值报错）
# ==========================================
# 假设输入端有 m, z, z_mating, b, Alpha
m = float(m) if 'm' in locals() else 2.0
z = int(z) if 'z' in locals() else 20
z_mating = int(z_mating) if 'z_mating' in locals() else 20
b = float(b) if 'b' in locals() else 15.0
Alpha = float(Alpha) if 'Alpha' in locals() else 20.0

# ==========================================
# 2. 数学函数别名
# ==========================================
Radians = math.radians
Pi = math.pi
Cos = math.cos
Sin = math.sin
Tan = math.tan
Atan = math.atan

# ==========================================
# 3. 锥齿轮核心参数计算
# ==========================================
r = m * z / 2.0                 # 实际分度圆半径
Delta = Atan(z / float(z_mating))  # 分度圆锥角 (弧度)
Re = r / Sin(Delta)             # 外锥距 (锥长)

# 齿宽限制安全检查
if b > Re / 3.0:
    b = Re / 3.0

# 齿高计算（严格采用国标标准正常齿：ha*=1, c*=0.25）
ha = 1.0 * m                    # 齿顶高
hf = 1.25 * m                   # 齿根高 (国标标准正常齿为 1.25m)

theta_a = Atan(ha / Re)         # 齿顶角
theta_f = Atan(hf / Re)         # 齿根角 

Delta_a = Delta + theta_a       # 面锥角
Delta_f = Delta - theta_f       # 根锥角

# ==========================================
# 4. 大端背锥当量圆参数计算 (用于推导 2D 渐开线)
# ==========================================
rv = r / Cos(Delta)             # 当量分度圆半径 (物理大端在背锥展开后的半径)
rvb = rv * Cos(Radians(Alpha))  # 当量基圆半径

# 严格依据国标公式计算：分度圆单侧半齿厚对应的圆心张角 theta
# 包含了渐开线函数 inv(α) = tanα - α 的严格修正
inv_alpha = Tan(Radians(Alpha)) - Radians(Alpha)
theta = Pi / (2.0 * z * Cos(Delta)) + inv_alpha

# 修正后的当量大端齿顶圆、齿根圆半径（画 2D 轮廓的截面线时用这两个）
rva = rv + ha                   # 当量大端齿顶圆半径
rvf = rv - hf                   # 当量大端齿根圆半径

# ==========================================
# 5. 输出变量给 Grasshopper (可选)
# ==========================================
# 此时你可以在下方直接用这些变量和 Rhino.Geometry 计算点、生成曲线了
# ---------- end S ----------
pt = ConstructPoint(XCoordinate=0, YCoordinate=0, ZCoordinate=0)
渐开线 = 渐开线(num=S.rvb)

panel = Panel("输出分度圆锥角Delta/δ")
expression = Expression(z=S.z, z_mating=S.z_mating, Expression="Atan(z/z_mating)")

rotate = Rotate(Geometry=渐开线, Angle=expr("-x", S.theta), Plane=PlaneXY(0, 0, 0))  # -> Geometry, Transform
merge = Merge(Data1=S.rva, Data2=S.rvf)
cir = Circle(Plane=PlaneXY(0, 0, 0), Radius=merge)
end = EndPoints(Curve=rotate.Geometry)  # -> Start, End
pt_2 = Point(end.Start)
item = ListItem(List=cir, Index=0, Wrap=True)  # -> Item, Item1
ln = Line(StartPoint=pt_2, EndPoint=pt)
merge_2 = Merge(Data1=rotate.Geometry, Data2=ln)

expression_2 = Expression(m=S.m, z=S.z, Delta=expression, Expression="(m*z/2)/Cos(Delta)")
panel_2 = Panel("分度圆半径rv")

join = JoinCurves(Curves=merge_2, Preserve=False)
ccx = CurveCurve(CurveA=join, CurveB=cir)  # -> Points, ParamsA, ParamsB
shatter = Shatter(Curve=join, Parameters=flatten(ccx.ParamsA))
item_2 = ListItem(List=shatter, Index=1, Wrap=True)

rad = Radians(Degrees=S.Alpha)
expression_3 = Expression(rv=expression_2, Alpha=rad, Expression="rv*Cos(Alpha)")
panel_3 = Panel("基圆半径rvb")

xz = XZPlane(Origin=Point(0, 0, 0))
mirror = Mirror(Geometry=item_2, Plane=xz)  # -> Geometry, Transform
merge_3 = Merge(Data1=mirror.Geometry, Data2=item_2)
ccx_2 = CurveCurve(CurveA=merge_3, CurveB=graft(cir))  # -> Points, ParamsA, ParamsB

rad_2 = Radians(Degrees=S.Alpha)
expression_4 = Expression(z=S.z, Delta=expression, Alpha=rad_2, Expression="π/(2*z*Cos(Delta))+ Tan(Alpha)-Alpha")
panel_4 = Panel("分度圆单侧半齿厚对应的圆心张角theta")

trim = TrimTree(Tree=ccx_2.ParamsB, Depth=1)
shatter_2 = Shatter(Curve=graft(cir), Parameters=trim)
trim_2 = TrimTree(Tree=shatter_2, Depth=1)
item_3 = ListItem(List=trim_2, Index=-1, Wrap=True)
merge_4 = Merge(Data1=item_3, Data2=merge_3)  # -> flatten(Result)
join_2 = JoinCurves(Curves=merge_4, Preserve=False)
arrpolar = PolarArray(Geometry=join_2, Plane=PlaneXY(0, 0, 0), Count=S.z, Angle=6.283185307)  # -> Geometry, Transform
pln = Plane(pt)
Z = UnitZ(Factor=S.H)
merge_5 = Merge(Data1=arrpolar.Geometry, Data2=item.Item1)  # -> flatten(Result)
runion = RegionUnion(Curves=merge_5)
move = Move(Geometry=pln, Motion=Z)  # -> Geometry, Transform
orient = Orient(Geometry=runion, Source=pln, Target=move.Geometry)  # -> Geometry, Transform
expression_5 = Expression(b=S.b, Re=S.Re, Expression="(Re-b)/Re")
scale = Scale(Geometry=orient.Geometry, Center=move.Geometry, Factor=expression_5)  # -> Geometry, Transform
merge_6 = Merge(Data1=runion, Data2=scale.Geometry)
loft = Loft(Curves=merge_6, Options={Adjust=False, Closed=False, LoftEnds=0, LoftSimp=0, LoftType=0, Rebuild=10, Refit=0.01})
cap = CapHoles(Brep=loft)
crv = Curve(merge_6)
B = ClusterOutput(cap)
crv_2 = ClusterOutput(crv)

# ==== cluster 渐开线
num = ClusterInput()

num_2 = Number(num)
dom = ConstructDomain(DomainStart=0, DomainEnd="0.8")
range = Range(Domain=dom, Steps="20")
expression = Expression(rvb=num_2, t=range, Expression="rvb*(Cos(t)+t*Sin(t))")
expression_2 = Expression(rvb=num_2, t=range, Expression="rvb*(Sin(t)-t*Cos(t))")
pt = ConstructPoint(XCoordinate=expression, YCoordinate=expression_2, ZCoordinate=0)
intcrv = Interpolate(Vertices=pt, Degree=3, Periodic=False, KnotStyle=1)  # -> Curve, Length, Domain

C = ClusterOutput(intcrv.Curve)
